# Grasshopper definition fume_hud.gh (Grasshopper 1.0.7)

srf = Surface(<surface referenced from the Rhino model>)
pt = Point(<point referenced from the Rhino model>)
pop2d = Populate2D(Region=srf, Count=Slider(126, range=0..1000), Seed=1)
dist = Distance(PointA=pop2d, PointB=pt)
dom = ConstructDomain(DomainStart=Slider(0.7, range=0..1), DomainEnd=Slider(0.82, range=0..1))
voronoi = Voronoi(Points=pop2d, Boundary=srf, BruteForceOverride=False)
bnd = Bounds(Numbers=dist)
remap = RemapNumbers(Value=dist, Source=bnd, Target=dom)  # -> Mapped, Clipped
area = Area(Geometry=voronoi)  # -> Area, Centroid
scale = Scale(Geometry=voronoi, Center=pop2d, Factor=remap.Mapped)  # -> Geometry, Transform
crv = Curve(<curve referenced from the Rhino model>)
Y = UnitY(Factor=Slider(3, range=0..10))
incurves = PointInCurves(Point=area.Centroid, Curves=crv)  # -> Relationship, Index, Point
division = Division(A=Y, B=Slider(2, range=0..10))
cull = CullPattern(List=incurves.Point, CullPattern=voronoi)
extr = Extrude(Base=srf, Direction=division)
extr_2 = Extrude(Base=scale.Geometry, Direction=Y)
cap = CapHoles(Brep=extr_2)
cap_2 = CapHoles(Brep=extr)
